# Dynamo graph 1_MeasureCircularity.dyn (Dynamo 2.10.1.3976)

# group: READ ME
# note: TBC...

# group: Check geometrical volume
code_block = CodeBlock { elem; }  # frozen; unwired: elem
code_block_2 = CodeBlock { "Volume"; }
getParameterValueByName = Element.GetParameterValueByName(element=code_block, parameterName=code_block_2)
sum = Math.Sum(values=getParameterValueByName)
sum_2 = Math.Sum(values=sum)
watch = Watch(sum_2)
geometry = Element.Geometry(element=code_block)  # frozen
flatten = List.Flatten(list=geometry)
volume = Solid.Volume(solid=flatten)
sum_3 = Math.Sum(values=volume)
code_block_3 = CodeBlock(x=sum_3) { x/1000000000; }
watch_2 = Watch(code_block_3)

# group: Get elements from groups
categories = Categories("OST_IOSModelGroups")  # frozen
all_elements_of_category = ElementsOfCategory(Category=categories)
getMembers = Group.GetMembers(group=all_elements_of_category)
flatten_2 = List.Flatten(list=getMembers)
uniqueItems = List.UniqueItems(list=flatten_2)

# group: Collect all elements
code_block_4 = CodeBlock()
# ---------- code_block_4.designscript (11 lines) ----------
[
"Doors",
"Windows",
"Floors",
"Structural Columns",
"Structural Framing",
"Walls",
"Ceilings",
"Columns",
"Structural Foundations"
];
# ----------------------------------------
include_the_foundations = BoolSelector(false)  # graph input
code_block_5 = CodeBlock { 8; -1; }
if_ = If(test=include_the_foundations, true=code_block_5.out0, false=code_block_5.out1)
removeItemAtIndex = List.RemoveItemAtIndex(list=code_block_4, indices=if_)
byName = Category.ByName(name=removeItemAtIndex)
all_elements_of_category_2 = ElementsOfCategory(Category=byName)
flatten_3 = List.Flatten(list=all_elements_of_category_2)

# group: Collect materials
getMaterials = Element.GetMaterials(element=flatten_3)
name = Material.Name(material=getMaterials)
string_from_array = FromArray()  # unwired: arr
map = List.Map(list=name, f_x=string_from_array)
code_block_6 = CodeBlock(str=map) { x1 = String.Replace(str,"[",""); x2 = String.Replace(x1,"]",""); x3 = String.Replace(x2,",",", "); }
code_block_7 = CodeBlock(materials=code_block_6.x3) { materials; }

# group: Collect parameters
code_block_8 = CodeBlock(elem=flatten_3) { elem; }
id = Element.Id(element=code_block_8)
getCategory = Element.GetCategory(element=code_block_8)
string_from_object = FromObject(object=getCategory)
list_create = List.Create(item0=code_block_8, item1=id, item2=string_from_object)
code_block_9 = CodeBlock()
# ---------- code_block_9.designscript (6 lines) ----------
[
"Area",
"Volume"
];
//"Length",
//"Thickness",
# ----------------------------------------
getParameterValueByName_2 = Element.GetParameterValueByName(element=code_block_8, parameterName=code_block_9, lacing=CrossProduct)
transpose = List.Transpose(lists=getParameterValueByName_2)
code_block_10 = CodeBlock { "Type"; }
getParameterValueByName_3 = Element.GetParameterValueByName(element=code_block_8, parameterName=code_block_10, lacing=Longest)
code_block_11 = CodeBlock()
# ---------- code_block_11.designscript (3 lines) ----------
[
"Type Name"
];
# ----------------------------------------
getParameterValueByName_4 = Element.GetParameterValueByName(element=getParameterValueByName_3, parameterName=code_block_11, lacing=CrossProduct)
transpose_2 = List.Transpose(lists=getParameterValueByName_4)
join = List.Join(list0=list_create, list1=transpose, list2=transpose_2)
transpose_3 = List.Transpose(lists=join)
watch_3 = Watch(transpose_3)

# group: Circularity calculations
string = StringInput(".\snippets\Circularity_indicator.py")
file_from_path = FileObject(path=string)
readText = FileSystem.ReadText(file=file_from_path)
watch_4 = Watch(watch_3)
py_circularity_indicator_calcs = PythonStringNode(script=readText, IN[0]=watch_4)  # IronPython2
watch_5 = Watch(py_circularity_indicator_calcs)

# group: Circularity results
average = Math.Average(numbers=watch_5)
code_block_12 = CodeBlock(x=average) { "Your average Circularity Indicator is: "+x+"."; }
circularity_indicator_score = Watch(code_block_12)  # graph output

# group: Take internal unit of measure ID
unit_types = UnitTypes("Area")
py_revit_version = Python()  # IronPython2
# ---------- py_revit_version.python (12 lines) ----------
import clr
clr.AddReference("RevitServices")
import RevitServices
from RevitServices.Persistence import DocumentManager

doc = DocumentManager.Instance.CurrentDBDocument
uiapp = DocumentManager.Instance.CurrentUIApplication
app = uiapp.Application
if int(app.VersionNumber) > 2017: fullVersion = app.SubVersionNumber
else: fullVersion = str(app.VersionNumber)

OUT = app.VersionName, int(app.VersionNumber), app.VersionBuild, app.Language.ToString(), fullVersion
# ----------------------------------------
code_block_13 = CodeBlock(seq=py_revit_version) { version = seq[1]; }
python_script = Python(IN[0]=unit_types, IN[1]=code_block_13)  # IronPython2
# ---------- python_script.python (43 lines) ----------
import clr
clr.AddReference('RevitAPI')
from Autodesk.Revit.DB import *

clr.AddReference("RevitServices")
import RevitServices
from RevitServices.Persistence import DocumentManager
doc = DocumentManager.Instance.CurrentDBDocument

dynunittype = IN[0]
if IN[1] > 2021:
	if str(dynunittype.GetType()) == "Autodesk.Revit.DB.ForgeTypeId":
		unittype = dynunittype
	elif str(dynunittype) == 'DynamoUnits.Area':
		unittype = ForgeTypeId('autodesk.spec.aec:area-2.0.0')
	elif str(dynunittype) == 'DynamoUnits.Length':
		unittype = ForgeTypeId('autodesk.spec.aec:length-2.0.0')
	elif str(dynunittype) == 'DynamoUnits.Volume':
		unittype = ForgeTypeId('autodesk.spec.aec:volume-2.0.0')
	else:
		unittype = None
	formatoptions = doc.GetUnits().GetFormatOptions(unittype)
	dispunits = formatoptions.GetUnitTypeId()
	symtype = formatoptions.GetSymbolTypeId()
	if symtype.TypeId == '': dispsym = None
	else: dispsym = LabelUtils.GetLabelForSymbol(symtype)
else:
	if str(dynunittype.GetType()) == "Autodesk.Revit.DB.UnitType":
		unittype = dynunittype
	elif str(dynunittype) == 'DynamoUnits.Area':
		unittype = UnitType.UT_Area
	elif str(dynunittype) == 'DynamoUnits.Length':
		unittype = UnitType.UT_Length
	elif str(dynunittype) == 'DynamoUnits.Volume':
		unittype = UnitType.UT_Volume
	else:
		unittype = None
	formatoptions = doc.GetUnits().GetFormatOptions(unittype)
	dispunits = formatoptions.DisplayUnits
	symtype = formatoptions.UnitSymbol
	if symtype == UnitSymbolType.UST_NONE: dispsym = None
	else: dispsym = LabelUtils.GetLabelFor(symtype)
OUT = (dispunits,dispsym)
# ----------------------------------------
code_block_14 = CodeBlock(seq=python_script) { displayUnitType = seq[0]; unitSymbol = seq[1]; }
unit_types_2 = UnitTypes("Volume")
python_script_2 = Python(IN[0]=unit_types_2, IN[1]=code_block_13)  # IronPython2; same code as python_script
code_block_15 = CodeBlock(seq=python_script_2) { displayUnitType = seq[0]; unitSymbol = seq[1]; }

# group: Collect info about materials (layers)
code_block_16 = CodeBlock(elem=flatten_3) { elem; }
turn_into_list = CodeBlock(x=code_block_16) { List.Flatten([x]); }
returnPaintMaterials = BoolSelector(false)
py_material_clockwork = Python(IN[0]=turn_into_list, IN[1]=returnPaintMaterials)  # IronPython2
# ---------- py_material_clockwork.python (22 lines) ----------
import clr
clr.AddReference('RevitAPI')
from Autodesk.Revit.DB import *

items = UnwrapElement(IN[0])
paintedmats = IN[1]
elementmats = list()
elementareas = list()
elementvols = list()

for item in items:
	matlist = list()
	arealist = list()
	vollist = list()
	for matid in item.GetMaterialIds(paintedmats):
		matlist.append(item.Document.GetElement(matid))
		arealist.append(item.GetMaterialArea(matid,paintedmats))
		vollist.append(item.GetMaterialVolume(matid))
	elementmats.append(matlist)
	elementareas.append(arealist)
	elementvols.append(vollist)
OUT = (elementmats,elementareas,elementvols)
# ----------------------------------------
code_block_17 = CodeBlock(seq=py_material_clockwork) { seq[0]; seq[1]; seq[2]; }
isEmpty = List.IsEmpty()  # unwired: list
map_2 = List.Map(list=code_block_17.out0, function=isEmpty)
not_ = Not(x=map_2)
py_returnlistorsinglevalue = Python(IN[0]=code_block_16, IN[1]=not_)  # IronPython2
# ---------- py_returnlistorsinglevalue.python (4 lines) ----------
check = IN[0]
items = IN[1]
if isinstance(check, (list)): OUT = items
else: OUT = items[0]
# ----------------------------------------
code_block_18 = CodeBlock(hasMaterial=py_returnlistorsinglevalue) { hasMaterial; }
code_block_19 = CodeBlock(value=code_block_17.out1, displayUnitType=code_block_14.displayUnitType, RevitVersion=code_block_13) { value; displayUnitType; RevitVersion; }
py_internalunit_todisplayunit = Python(IN[0]=code_block_19.value, IN[1]=code_block_19.displayUnitType, IN[2]=code_block_19.RevitVersion)  # "Py InternalUnit.ToDisplayUnit (Clockwork)"; IronPython2
# ---------- py_internalunit_todisplayunit.python (26 lines) ----------
import clr
clr.AddReference('RevitAPI')
from Autodesk.Revit.DB import *

def FromInternalUnits(val, unittype):
	if (version > 2021 and str(dispunit.GetType()) == "Autodesk.Revit.DB.ForgeTypeId") or (version < 2022 and str(dispunit.GetType()) == "Autodesk.Revit.DB.DisplayUnitType"):
		return UnitUtils.ConvertFromInternalUnits(val,unittype)
	else: return None

vals = IN[0]
dispunit = IN[1]
version = IN[2]

# turn into list of lists:
if not isinstance(vals[0], list):
    vals = [vals]
if not isinstance(vals[0], list):
    vals = [vals]

OUT = []

for list in vals:
	inner = []
	for x in list:
		inner.append(FromInternalUnits(x, dispunit))
	OUT.append(inner)
# ----------------------------------------
py_returnlistorsinglevalue_2 = Python(IN[0]=code_block_16, IN[1]=py_internalunit_todisplayunit)  # IronPython2; same code as py_returnlistorsinglevalue
code_block_20 = CodeBlock(materialAreas=py_returnlistorsinglevalue_2) { materialAreas; }
py_returnlistorsinglevalue_3 = Python(IN[0]=code_block_16, IN[1]=code_block_17.out0)  # IronPython2; same code as py_returnlistorsinglevalue
code_block_21 = CodeBlock(materials=py_returnlistorsinglevalue_3) { materials; }
name_2 = Material.Name(material=code_block_21)
code_block_22 = CodeBlock(value=code_block_17.out2, displayUnitType=code_block_15.displayUnitType, RevitVersion=code_block_13) { value; displayUnitType; RevitVersion; }
py_internalunit_todisplayunit_2 = Python(IN[0]=code_block_22.value, IN[1]=code_block_22.displayUnitType, IN[2]=code_block_22.RevitVersion)  # "Py InternalUnit.ToDisplayUnit (Clockwork)"; IronPython2; same code as py_internalunit_todisplayunit
py_returnlistorsinglevalue_4 = Python(IN[0]=code_block_16, IN[1]=py_internalunit_todisplayunit_2)  # IronPython2; same code as py_returnlistorsinglevalue
code_block_23 = CodeBlock(materialVolumes=py_returnlistorsinglevalue_4) { materialVolumes; }

code_block_24 = CodeBlock(materialAreas=code_block_20) { materialAreas; }

# group: Match materials
string_2 = StringInput(".\snippets\Map_names.py")
file_from_path_2 = FileObject(path=string_2)
readText_2 = FileSystem.ReadText(file=file_from_path_2)
string_3 = StringInput(".\data\Material_mapping.json")
file_from_path_3 = FileObject(path=string_3)
readText_3 = FileSystem.ReadText(file=file_from_path_3)
code_block_25 = CodeBlock(materials=name_2) { materials; }
watch_6 = Watch(code_block_25)
py_match_material_names = PythonStringNode(script=readText_2, IN[0]=readText_3, IN[1]=watch_6)  # CPython3
watch_7 = Watch(py_match_material_names)

code_block_26 = CodeBlock(materialVolumes=code_block_23) { materialVolumes; }

# group: Split RC into steel and concrete (using constant ratio)
code_block_27 = CodeBlock(materials=watch_7, volumes=code_block_26) { materials; volumes; steel_concrete_ratio = 0.025; }
python_script_3 = Python(IN[0]=code_block_27.materials, IN[1]=code_block_27.volumes, IN[2]=code_block_27.steel_concrete_ratio)  # CPython3
# ---------- python_script_3.python (26 lines) ----------
# Load the Python Standard and DesignScript Libraries
import sys
import clr
clr.AddReference('ProtoGeometry')
from Autodesk.DesignScript.Geometry import *
from copy import deepcopy

materials = IN[0]
volumes = IN[1]
steel_concrete_ratio = IN[2]

new_materials = deepcopy(materials)
new_volumes = deepcopy(volumes)

for i in range(len(materials)):
    for j in range(len(materials[i])):
        if materials[i][j] == "Concrete":
            new_volumes[i][j] = volumes[i][j] * (1-steel_concrete_ratio)
            if "Steel" in materials[i]:
                steel_id = materials[i].index("Steel")
                new_volumes[i][steel_id] = volumes[i][j]*steel_concrete_ratio
            else:
                new_materials[i].append("Steel")
                new_volumes[i].append(volumes[i][j]*steel_concrete_ratio)

OUT = [new_materials, new_volumes, volumes[i][j]]
# ----------------------------------------
code_block_28 = CodeBlock(seq=python_script_3) { materials = seq[0]; volumes = seq[1]; }

watch_8 = Watch(code_block_28.materials)
watch_9 = Watch(code_block_28.volumes)

# group: Save results to parameter
code_block_29 = CodeBlock { "Product Circularity Indicator"; }
setParameterByName = Element.SetParameterByName(element=code_block_8, parameterName=code_block_29, value=watch_5)  # frozen

string_4 = StringInput(".\data\Lifespan_expectancy.json")
file_from_path_4 = FileObject(path=string_4)
readText_4 = FileSystem.ReadText(file=file_from_path_4)
